# Grasshopper definition LandArchTools For Grasshopper.gh (Grasshopper 1.0.7)
# plug-ins: Groundhog, Pufferfish, EleFront, Wombat, Tundra, MetaHopper, Heteroptera, Human, Scatter, Anemone, Kangaroo2 Components
# LANDSCAPE ARCHITECTURE FOCUSED TOOL FOR GRADING.

# ----
# SCRIPT MANAGER
selobj = GetSelectedObjects(AllObjects_Object=[preview_7, swatch_2, cluster])  # -> ComponentObjects, ParamObjects, OtherObjects
wiredisplay = ControlWireDisplay(Objects=selobj.ComponentObjects, WireDisplay=2, AllObjects_Object=[preview_7, cluster])
colour = ColourPicker(PickedColour=RGB(159, 107, 219))
objbynn = GetObjectByNickname(NickName="DOC")
setgroup = SetGroupProperties(Group=objbynn, Style=1, Color=colour)
colour_2 = ColourPicker(PickedColour=RGB(95, 147, 128))
objbynn_2 = GetObjectByNickname(NickName="GRAD")
setgroup_2 = SetGroupProperties(Group=objbynn_2, Style=1, Color=colour_2)
colour_3 = ColourPicker(PickedColour=RGB(175, 164, 128))
objbynn_3 = GetObjectByNickname(NickName="MOD")
setgroup_3 = SetGroupProperties(Group=objbynn_3, Style=1, Color=colour_3)

selobj_2 = GetSelectedObjects(AllObjects_Object=[slope, concat_3, panel_9, roundd_3, number_slider_3, swatch_3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])  # -> ComponentObjects, ParamObjects, OtherObjects
hideshow = HideShowObjectPreview(Objects=selobj_2.ComponentObjects, Visible=False, AllObjects_Object=pipeline_4)
docinfo = DocumentInfo(AutoUpdate=True, Recursive=False)  # -> DocumentName, DocumentFilePath, Components, Params, _3rdPartyAssemblies
# BSD 3-Clause License
# 
# Copyright (c) 2021, Thomas Chapman
# All rights reserved.
# 
# Redistribution and use in source and binary forms, with or without
# modification, are permitted provided that the following conditions are met:
# 
# 1. Redistributions of source code must retain the above copyright notice, this
#    list of conditions and the following disclaimer.
# 
# 2. Redistributions in binary form must reproduce the above copyright notice,
#    this list of conditions and the following disclaimer in the documentation
#    and/or other materials provided with the distribution.
# 
# 3. Neither the name of the copyright holder nor the names of its
#    contributors may be used to endorse or promote products derived from
#    this software without specific prior written permission.
# 
# THIS SOFTWARE IS PROVIDED BY THE COPYRIGHT HOLDERS AND CONTRIBUTORS "AS IS"
# AND ANY EXPRESS OR IMPLIED WARRANTIES, INCLUDING, BUT NOT LIMITED TO, THE
# IMPLIED WARRANTIES OF MERCHANTABILITY AND FITNESS FOR A PARTICULAR PURPOSE ARE
# DISCLAIMED. IN NO EVENT SHALL THE COPYRIGHT HOLDER OR CONTRIBUTORS BE LIABLE
# FOR ANY DIRECT, INDIRECT, INCIDENTAL, SPECIAL, EXEMPLARY, OR CONSEQUENTIAL
# DAMAGES (INCLUDING, BUT NOT LIMITED TO, PROCUREMENT OF SUBSTITUTE GOODS OR
# SERVICES; LOSS OF USE, DATA, OR PROFITS; OR BUSINESS INTERRUPTION) HOWEVER
# CAUSED AND ON ANY THEORY OF LIABILITY, WHETHER IN CONTRACT, STRICT LIABILITY,
# OR TORT (INCLUDING NEGLIGENCE OR OTHERWISE) ARISING IN ANY WAY OUT OF THE USE
# OF THIS SOFTWARE, EVEN IF ADVISED OF THE POSSIBILITY OF SUCH DAMAGE.
addons_required = Panel(docinfo._3rdPartyAssemblies)

# ----
# SCATTER BLOCK ON SURF
# GRADING PARAMETERS
# STEP DIMENSIONS
# GRADE CURVE
# RAMP FINDER
# ROCK PARAMETERS
# WALL PARAMETERS
text_size = Slider(0.125, range=0..1)
arrow_length = Slider(0.224, range=0..2)
curve_complexity = Slider(0.854, range=0..5)
contour_interval = Slider(0.05, range=0..1)
calc_flow = BooleanToggle(False)
water_density = Slider(1000, range=0..1000)
bake_contours = Button()
bake_gradients = Button()
bake_spotheights = Button()
bake_water = Button()
# DOCUMENT MANAGEMENT
bake_tin = Button()
width = Slider(1, range=0.1..10)
height = Slider(3, range=0.1..10)
chamfer = Slider(0.05, range=0..1)
chamfer_type = BooleanToggle(False)
flip_wall = BooleanToggle(False)
bake_walls = Button()
tread = Slider(0.3, range=0..1)
riser = Slider(0.15, range=0..1)
number_of_steps = Slider(6, range=0..100)
flip_stair_direction = BooleanToggle(False)
bake_stairs = Button()
bake_graded_curve = Button()
grade_of_curve = Slider(20, range=0..100)
bake_rocks = Button()
rock_size = Slider(1, range=1..100)
noise = Slider(2.2, range=0..3)
preview = Preview(True)
bake_scatter = Button()
number_slider = Slider(1.6, range=0..10)
number_slider_2 = Slider(0.3, range=0..10)
scatter_amount = Slider(897, range=0..1000)
reset = Button()
on_off = BooleanToggle(True)
bake_ramp_curve = Button()
run_m = Slider(5, range=0..50)
rl_start_point = Slider(0, range=0..100)
grade_text_size = Slider(14, range=0..20)
landing_m = Slider(1.5, range=0..10)
grade = Slider(25, range=0..100)
rl_end_point = Slider(1.5, range=0..100)
level_text_size = Slider(10, range=0..20)

line_grades = BooleanToggle(False)
line_grade_size = Slider(0.071, range=0..1)
colour_grading = BooleanToggle(True)

# ---- group: DOC
# MODEL UNITS PARAMETERS
# PAGE UNITS PARAMETERS
modelangletolerancedegreesslider = Slider(1, range=0..3)
modelangletolerancedegreesslider_2 = Slider(1, range=0..3)
modelrelativetolerance = Slider(1, range=0.01..100)
pagerelativetolerance = Slider(1, range=0.01..100)
pageabsolutetolerance = Slider(0.001, range=0..0.1)
modelabsolutetolerance = Slider(0.001, range=0..0.1)
modeldistancedisplayprecision = ValueList({"1", "1.0", "1.00", "1.000", "1.0000", "1.00000", "1.000000", "1.0000000"}, selected="1.000")
modelunitsystem = ValueList({"Millimeters": 2, "Centimetres": 3, "Metres": 4}, selected="Metres")
modelunitsystem_2 = ValueList({"Millimeters": 2, "Centimetres": 3, "Metres": 4}, selected="Metres")
pagedistancedisplayprecision = ValueList({"1", "1.0", "1.00", "1.000", "1.0000", "1.00000", "1.000000", "1.0000000"}, selected="1.00")

# LAYER CREATION
swatch = ColourSwatch(SwatchColor=RGB(0, 0, 0))
panel = Panel("""GH::GH GRADING BOUNDARY
GH::GH GRADING POINTS 
GH::GH GRADING LINES
GH::GH TIN
GH::GH WATER
GH::GH STAIRS
GH::GH RAMP
GH::GH WALLS
GH::GH CONTOUR
GH::GH SPOT HEIGHTS
GH::GH GRADIENTS
GH::GH ROCKS
GH::GH GRADE LINE
GH::GH RAMP FINDER
GH::GH OFF""")
expression = Expression(x=panel, Expression="IF(X=\"GH::GH OFF\",FALSE,TRUE)")
merge = Merge(
    Data1=swatch,
    Data2=ColourSwatch(SwatchColor=RGB(255, 0, 255)),
    Data3=ColourSwatch(SwatchColor=RGB(255, 0, 255)),
    Data4=ColourSwatch(SwatchColor=RGB(0, 0, 0)),
    Data5=ColourSwatch(SwatchColor=RGB(220, 191, 101)),
    Data6=ColourSwatch(SwatchColor=RGB(0, 0, 255)),
    Data7=ColourSwatch(SwatchColor=RGB(0, 121, 255)),
    Data8=ColourSwatch(SwatchColor=RGB(214, 68, 75)),
    Data9=ColourSwatch(SwatchColor=RGB(0, 255, 255)),
    Data10=ColourSwatch(SwatchColor=RGB(0, 0, 0)),
    Data11=ColourSwatch(SwatchColor=RGB(0, 0, 0)),
    Data12=ColourSwatch(SwatchColor=RGB(255, 164, 78)),
    Data13=ColourSwatch(SwatchColor=RGB(169, 101, 90)),
    Data14=ColourSwatch(SwatchColor=RGB(53, 109, 102)),
    Data15=ColourSwatch(SwatchColor=RGB(102, 102, 102)))
layers = CreateModifyLayers(LayerName=panel, LayerColor=merge, Visibility=expression, DeleteLayer=False, enableFullPath=True)  # -> LayerNames, LayerFullPath

# ----
move_all_to_gh_off = Button()

# ---- group: BLOCKS TO SCATTER
id = Guid()

# ---- group: GEO TO SCATTER ON
extgeo = ExtendedGeometry()

# ----
flip_ramp_direction = BooleanToggle(False)
ramp_width = Slider(1.326, range=0..10)

# ---- group: MOD
# RAMP FINDER
pipeline = GeometryPipeline(
    GroupByLayer=False,
    GroupByType=False,
    IncludeHidden=True,
    IncludeLocked=True,
    LayerFilter="GH::GH RAMP FINDER",
    SublayerFiltering=True,
    TypeFilter=4)
ramp_finder = RAMPFINDER(
    B=landing_m,
    L_2=run_m,
    grade_2=grade,
    B_2=rl_start_point,
    grade=grade,
    D=ramp_width,
    L=pipeline,
    A=landing_m,
    P=flip_ramp_direction,
    reset=reset,
    on=on_off,
    B_3=landing_m,
    B_4=bake_ramp_curve,
    F_2=rl_start_point,
    F=rl_end_point)  # -> W, M, a_2, M_2, a, pt_14, Z_4, pt_13, Z_5
textdot = DefineTextDot(Text=ramp_finder.a, Location=ramp_finder.M, Font="Arial", Size=level_text_size)
textdot_2 = DefineTextDot(Text=ramp_finder.Z_4, Location=ramp_finder.pt_14, Font="Arial", Size=14)
textdot_3 = DefineTextDot(Text=ramp_finder.Z_5, Location=ramp_finder.pt_13, Font="Arial", Size=14)
textdot_4 = DefineTextDot(Text=ramp_finder.a_2, Location=ramp_finder.M_2, Font="Arial", Size=grade_text_size)
preview_2 = CustomPreview(Geometry=textdot, Material=ColourSwatch(SwatchColor=RGB(255, 255, 99)))
preview_3 = CustomPreview(Geometry=textdot_3, Material=ColourSwatch(SwatchColor=RGB(39, 217, 72)))
preview_4 = CustomPreview(Geometry=textdot_4, Material=ColourSwatch(SwatchColor=RGB(255, 0, 255)))
preview_5 = CustomPreview(Geometry=textdot_2, Material=ColourSwatch(SwatchColor=RGB(39, 205, 217)))
preview_6 = CustomPreview(Geometry=ramp_finder.W, Material=ColourSwatch(SwatchColor=RGB(255, 255, 255)))

# ---- group: GRAD
# CHANGE GEO LAYER
list = ValueList({"Default", "GH", "GH::GH BOUNDARY", "GH::GH POINTS FIXED", "GH::GH POINTS DESIGN", "GH::GH LINES FIXED", "GH::GH LINES DESIGN", "GH::GH STAIRS", "GH::GH RAMP", "GH::GH WALLS", "GH::GH CONTOUR", "GH::GH SPOT HEIGHTS", "GH::GH GRADIENTS", "GH::GH PEOPLE", "GH::GH ROCKS", "GH::GH BALUSTRADE", "GH::GH MESH", "GH::GH OFF"}, selected="GH::GH OFF")
attributes = DefineObjectAttributes(Layer=list)
modifyatt = ModifyRhinoObjectAttributes(Geometry=pipeline, Attributes=attributes, Modify=move_all_to_gh_off)

# ---- group: MOD
# WALL GENERATOR
pipeline_2 = GeometryPipeline(
    GroupByLayer=False,
    GroupByType=False,
    IncludeHidden=True,
    IncludeLocked=True,
    LayerFilter="GH::GH WALLS",
    SublayerFiltering=True,
    TypeFilter=4)
dispatch = Dispatch(List=pipeline_2, DispatchPattern=flip_wall)  # -> ListA, ListB
flip = FlipCurve(Curve=dispatch.ListA)  # -> Curve, Flag
offset = OffsetCurve(Curve=[flip.Curve, dispatch.ListB], Distance=width, Plane=PlaneXY(0, 0, 0), Corners=1)
crv = Curve([offset, flip.Curve, dispatch.ListB])
crv_2 = Curve(graft([flip.Curve, dispatch.ListB]))
crv_3 = Curve([crv_2, offset])
cp = ControlPoints(Curve=crv)  # -> Points, Weights, flatten(Knots)
end = EndPoints(Curve=crv_3)  # -> Start, End
shatter = Shatter(Curve=crv, Parameters=cp.Knots)
midpt = CurveMiddle(Curve=shatter)
pt = Point(end.Start)
pt_2 = Point(end.End)
pline = PolyLine(Vertices=pt, Closed=False)
pline_2 = PolyLine(Vertices=pt_2, Closed=False)
Z = UnitZ(Factor=height)
move = Move(Geometry=midpt, Motion=Z)  # -> Geometry, Transform
crv_4 = Curve([pline, pline_2, crv_3])
join = JoinCurves(Curves=crv_4, Preserve=False)
extr = Extrude(Base=join, Direction=Z)
list_2 = ValueList({"Default", "GH", "GH::GH BOUNDARY", "GH::GH POINTS FIXED", "GH::GH POINTS DESIGN", "GH::GH LINES FIXED", "GH::GH LINES DESIGN", "GH::GH STAIRS", "GH::GH RAMP", "GH::GH WALLS", "GH::GH CONTOUR", "GH::GH SPOT HEIGHTS", "GH::GH GRADIENTS", "GH::GH PEOPLE", "GH::GH ROCKS", "GH::GH BALUSTRADE", "GH::GH MESH", "GH::GH OFF"}, selected="GH::GH WALLS")
cap = CapHoles(Brep=extr)  # -> flatten(Brep)
edgespt = EdgesFromPoints(Brep=cap, Points=move.Geometry, Valence=1)  # -> Edges, flatten(Indices), Map
attributes_2 = DefineObjectAttributes(Name="WALL", Layer=list_2)
filedge = FilletEdge(Shape=cap, Blend=chamfer_type, Metric=0, Edges=edgespt.Indices, Radii=chamfer)
bake = BakeObjects(Geometry=filedge, Attributes=attributes_2, Bake=bake_walls)

# STAIR GENERATOR
pipeline_3 = GeometryPipeline(
    GroupByLayer=False,
    GroupByType=False,
    IncludeHidden=True,
    IncludeLocked=True,
    LayerFilter="GH::GH STAIRS",
    SublayerFiltering=True,
    TypeFilter=4)
dispatch_2 = Dispatch(List=pipeline_3, DispatchPattern=flip_stair_direction)  # -> ListA, ListB
flip_2 = FlipCurve(Curve=dispatch_2.ListB)  # -> Curve, Flag
crv_5 = Curve([dispatch_2.ListA, flip_2.Curve])
x_plus_one = XPlusOne(NumberX=number_of_steps)
fastloopstart = FastLoopStart(I=number_of_steps, D0=crv_5)  # -> port, Counter, Data, Data_2
multiplication = Multiplication(A=riser, B=x_plus_one)
offset_2 = OffsetCurve(Curve=fastloopstart.Data, Distance=tread, Plane=PlaneXY(0, 0, 0), Corners=1)
neg = Negative(Value=multiplication)
end_2 = EndPoints(Curve=fastloopstart.Data)  # -> Start, End
neg_2 = Negative(Value=riser)
Z_2 = UnitZ(Factor=neg)
Z_3 = UnitZ(Factor=neg_2)
end_3 = EndPoints(Curve=offset_2)  # -> Start, End
move_2 = Move(Geometry=offset_2, Motion=Z_3)  # -> Geometry, Transform
move_3 = Move(Geometry=end_3.Start, Motion=Z_3)  # -> Geometry, Transform
pt_3 = Point(flatten([end_2.Start, end_3.Start, move_3.Geometry]))
pline_3 = PolyLine(Vertices=pt_3, Closed=False)
crv_6 = Curve(move_2.Geometry)
fastloopend = FastLoopEnd(port=fastloopstart.port, Exit=False, Data=crv_6, Data_2=pline_3, RecordData=True, TimeOutVal=0)  # -> Data, D1
crv_7 = Curve(flatten(fastloopend.D1))
join_2 = JoinCurves(Curves=crv_7, Preserve=False)
end_4 = EndPoints(Curve=join_2)  # -> Start, End
move_4 = Move(Geometry=end_4.Start, Motion=Z_2)  # -> Geometry, Transform
pt_4 = Point(flatten([end_4.Start, move_4.Geometry, end_4.End]))
pline_4 = PolyLine(Vertices=pt_4, Closed=False)
crv_8 = Curve(flatten([pline_4, join_2]))
join_3 = JoinCurves(Curves=crv_8, Preserve=False)
swp1 = Sweep1(Rail=crv_5, Sections=join_3, Miter=1)
list_3 = ValueList({"Default", "GH", "GH::GH BOUNDARY", "GH::GH POINTS FIXED", "GH::GH POINTS DESIGN", "GH::GH LINES FIXED", "GH::GH LINES DESIGN", "GH::GH STAIRS", "GH::GH RAMP", "GH::GH WALLS", "GH::GH CONTOUR", "GH::GH SPOT HEIGHTS", "GH::GH GRADIENTS", "GH::GH PEOPLE", "GH::GH ROCKS", "GH::GH BALUSTRADE", "GH::GH MESH", "GH::GH OFF"}, selected="GH::GH STAIRS")
cap_2 = CapHoles(Brep=swp1)
attributes_3 = DefineObjectAttributes(Name="STAIRS", Layer=list_3)
bake_2 = BakeObjects(Geometry=cap_2, Attributes=attributes_3, Bake=bake_stairs)

# GRADE CURVE
pipeline_4 = GeometryPipeline(
    GroupByLayer=False,
    GroupByType=False,
    IncludeHidden=True,
    IncludeLocked=True,
    LayerFilter="GH::GH GRADE LINE",
    SublayerFiltering=True,
    TypeFilter=4)
cluster = Cluster(B=grade_of_curve, C=pipeline_4, B_2=bake_graded_curve)
swatch_2 = ColourSwatch(SwatchColor=RGB(255, 255, 255))
preview_7 = CustomPreview(Geometry=cluster, Material=swatch_2)

# ---- group: MOD / Populate as xy planes
popgeo = PopulateGeometry(Geometry=extgeo, Count=scatter_amount, Seed=1)

# ---- group: MOD
# ROCK GENERATOR
pipeline_5 = GeometryPipeline(
    GroupByLayer=False,
    GroupByType=False,
    IncludeHidden=True,
    IncludeLocked=True,
    LayerFilter="GH::GH ROCKS",
    SublayerFiltering=True,
    TypeFilter=1)
panel_2 = Panel(pipeline_5)
improvedperlin = ImprovedPerlin(Seed=1, Quality=2, gradient="tundraGradient")
seed = SeedGenerator(Number=1)
panel_3 = Panel(seed)
lng = ListLength(List=pipeline_5)
scale = Scale(Module=improvedperlin, XScale=noise, YScale=noise, ZScale=noise, gradient="Heat")
random = Random(Range=Slider(10000, range=0..10000), Number=lng, Seed=panel_3)
box = CenterBox(Base=pipeline_5, X=rock_size, Y=rock_size, Z=rock_size)
int = Integer(reverse(random))
pop3d = Populate3D(Region=box, Count=Slider(15, range=2..100), Seed=int)  # -> flatten(Population)
vcell = VoronoiCell(Point=pipeline_5, Neighbours=pop3d)
panel_4 = Panel(int)
mesh = MeshBrep(
    Brep=vcell,
    Settings={GridMaxCount=500, GridMinCount=100, JaggedSeams=False, MaxEdgeLength=0, MinEdgeLength=0.0001, MinTolerance=0, Refine=True, RefineAngle=0, RelativeTolerance=0.65, SimplePlanes=False, Tolerance=0})
gradient = Gradient(ModuleX=scale, ModuleY=scale, ModuleZ=scale)
list_4 = ValueList({"Default", "GH", "GH::GH BOUNDARY", "GH::GH POINTS FIXED", "GH::GH POINTS DESIGN", "GH::GH LINES FIXED", "GH::GH LINES DESIGN", "GH::GH STAIRS", "GH::GH RAMP", "GH::GH WALLS", "GH::GH CONTOUR", "GH::GH SPOT HEIGHTS", "GH::GH GRADIENTS", "GH::GH PEOPLE", "GH::GH ROCKS", "GH::GH BALUSTRADE", "GH::GH MESH", "GH::GH OFF"}, selected="GH::GH ROCKS")
multiplication_2 = Multiplication(A=Slider(58.83, range=0..100), B=rock_size)
fieldmorph = FieldMorph(Geometry=mesh, Field=gradient, Strenth=multiplication_2, Steps=Slider(2, range=0..10), DifferentialSolver=1)
attributes_4 = DefineObjectAttributes(Name="ROCK", Layer=list_4)
bake_3 = BakeObjects(Geometry=fieldmorph, Attributes=attributes_4, Bake=bake_rocks)

# SCATTER
panel_5 = Panel("")
pln = Plane(popgeo)
scatter = Scatter(
    GeometryAsGuid=id,
    TargetPlanes=pln,
    RotationMin=Slider(78.8, range=0..180),
    ScaleXMin=number_slider,
    ScaleYMin=number_slider,
    ScaleZMin=number_slider,
    RotationMax=Slider(180, range=0..180),
    ScaleXMax=number_slider_2,
    ScaleYMax=number_slider_2,
    ScaleZMax=number_slider_2,
    Seed=Slider(5.3, range=0..10),
    Block=panel_5,
    Preview=preview,
    Activate=bake_scatter)

# ----
# INFO@LANDARCHTOOLS.COM
# WWW.LANDARCHTOOLS.COM
# V1.01
# CHANGE MODEL UNITS TO METERS
# AFTER CREATING LAYERS AND CHANGING UNITS TO METERS. (THIS WILL NOT SCALE THE MODEL)
# DRAW POINTS AND LINES IN CORRESPONDING LAYERS.
# GRADING REQUIRES CLOSED POLYGON IN "GH BOUNDARY"
change_units = Button()

# ---- group: DOC
# CHANGE MODEL UNITS
exécuter = Boolean(change_units)
pageunitsystem = Integer(modelunitsystem_2)
modelunitsystem_3 = Integer(modelunitsystem)
pagerelativetolerance_2 = Number(pagerelativetolerance)
pageabsolutetolerance_2 = Number(pageabsolutetolerance)
modelrelativetolerance_2 = Number(modelrelativetolerance)
modelabsolutetolerance_2 = Number(modelabsolutetolerance)
pageangletolerancedegrees = Number(modelangletolerancedegreesslider_2)
modelangletolerancedegrees = Number(modelangletolerancedegreesslider)
pagedistancedisplayprecision_2 = Text(pagedistancedisplayprecision)
modeldistancedisplayprecision_2 = Text(modeldistancedisplayprecision)
set_rhino_tolerance_rfy = VBScript(
    OnOff=exécuter,
    ModelUnitSystem=modelunitsystem_3,
    ModelAbsoluteTolerance=modelabsolutetolerance_2,
    ModelRelativeTolerance=modelrelativetolerance_2,
    ModelAngleToleranceDegrees=modelangletolerancedegrees,
    ModelDistanceDisplayPrecision=modeldistancedisplayprecision_2,
    PageUnitSystem=pageunitsystem,
    PageAbsoluteTolerance=pageabsolutetolerance_2,
    PageRelativeTolerance=pagerelativetolerance_2,
    PageAngleToleranceDegrees=pageangletolerancedegrees,
    PageDistanceDisplayPrecision=pagedistancedisplayprecision_2)  # -> out, Done
# ---------- set_rhino_tolerance_rfy: C# ----------
    If OnOff = True Then
      RhinoDoc.ActiveDoc.ModelUnitSystem = ModelUnitSystem
      RhinoDoc.ActiveDoc.ModelAbsoluteTolerance = ModelAbsoluteTolerance
      RhinoDoc.ActiveDoc.ModelRelativeTolerance = ModelRelativeTolerance / 100
      RhinoDoc.ActiveDoc.ModelAngleToleranceDegrees = ModelAngleToleranceDegrees
      RhinoDoc.ActiveDoc.ModelDistanceDisplayPrecision = ModelDistanceDisplayPrecision.Split(".")(1).Length

      RhinoDoc.ActiveDoc.PageUnitSystem = PageUnitSystem
      RhinoDoc.ActiveDoc.PageAbsoluteTolerance = PageAbsoluteTolerance
      RhinoDoc.ActiveDoc.PageRelativeTolerance = PageRelativeTolerance / 100
      RhinoDoc.ActiveDoc.PageAngleToleranceDegrees = PageAngleToleranceDegrees
      RhinoDoc.ActiveDoc.PageDistanceDisplayPrecision = PageDistanceDisplayPrecision.Split(".")(1).Length

      Done = True
    Else
      Done = False
    End if
# ---------- end set_rhino_tolerance_rfy ----------
doc_units = DocumentUnits()
done = Boolean(set_rhino_tolerance_rfy.Done)
panel_6 = Panel(done)

# ----
current_doc_units = Panel(doc_units)

# ---- group: GRAD
# DRAW GRADIENTS
number_slider_3 = Slider(1, range=0..5)
panel_7 = Panel("+Infinity")
panel_8 = Panel("0")
panel_9 = Panel("1:")
number_slider_4 = Slider(-1, range=-1..1)
list_5 = ValueList({"BottomLeft", "MiddleLeft", "TopLeft", "BottomCenter", "MiddleCenter", "TopCenter", "BottomRight", "MiddleRight", "TopRight"}, selected="TopCenter")
swatch_3 = ColourSwatch(SwatchColor=RGB(255, 255, 255))
list_6 = ValueList({"Default", "GH", "GH::GH BOUNDARY", "GH::GH POINTS FIXED", "GH::GH POINTS DESIGN", "GH::GH LINES FIXED", "GH::GH LINES DESIGN", "GH::GH STAIRS", "GH::GH RAMP", "GH::GH WALLS", "GH::GH CONTOUR", "GH::GH SPOT HEIGHTS", "GH::GH GRADIENTS", "GH::GH PEOPLE", "GH::GH ROCKS", "GH::GH BALUSTRADE", "GH::GH MESH", "GH::GH OFF"}, selected="GH::GH GRADIENTS")
attributes_5 = DefineObjectAttributes(Layer=list_6)

# CULL OUTSIDE BOUNDARY
xy = XYPlane(Origin=Point(0, 0, 0))

# LINE GRADES
number_slider_5 = Slider(0.5, range=0..1)
panel_10 = Panel("1:")
number_slider_6 = Slider(1, range=0..10)
swatch_4 = ColourSwatch(SwatchColor=RGB(255, 240, 171))

# GRAB GEO FROM RHINO
pipeline_6 = GeometryPipeline(
    GroupByLayer=False,
    GroupByType=False,
    IncludeHidden=True,
    IncludeLocked=True,
    LayerFilter="GH::GH GRADING BOUNDARY",
    SublayerFiltering=True,
    TypeFilter=4)
pipeline_7 = GeometryPipeline(
    GroupByLayer=False,
    GroupByType=False,
    IncludeHidden=True,
    IncludeLocked=True,
    LayerFilter="GH::GH GRADING LINES",
    SublayerFiltering=True,
    TypeFilter=4)
# GRADING
pipeline_8 = GeometryPipeline(
    GroupByLayer=False,
    GroupByType=False,
    IncludeHidden=True,
    IncludeLocked=True,
    LayerFilter="GH::GH GRADING POINTS",
    SublayerFiltering=True,
    TypeFilter=1)
relay = Relay([pipeline_7, pipeline_6])
cp_2 = ControlPoints(Curve=relay)  # -> Points, Weights, Knots
divdist = DivideDistance(Curve=relay, Distance=curve_complexity)  # -> Points, Tangents, Parameters
list_7 = ValueList({"Default", "GH", "GH::GH GRADING BOUNDARY", "GH::GH GRADING POINTS", "GH::GH GRADING LINES", "GH::GH TIN", "GH::GH STAIRS", "GH::GH RAMP", "GH::GH WALLS", "GH::GH CONTOUR", "GH::GH SPOT HEIGHTS", "GH::GH GRADIENTS", "GH::GH PEOPLE", "GH::GH ROCKS", "GH::GH BALUSTRADE", "GH::GH OFF"}, selected="GH::GH TIN")
duppt = RemoveDuplicatePts(Points=flatten([divdist.Points, cp_2.Points]), Tolerance=0.01)
panel_11 = Panel("TIN")
attributes_6 = DefineObjectAttributes(Name=panel_11, Layer=list_7)
cp_3 = ControlPoints(Curve=[pipeline_6, pipeline_7])  # -> Points, Weights, Knots
swatch_5 = ColourSwatch(SwatchColor=RGB(135, 135, 135))

cullpt = CullDuplicates(Points=flatten([duppt, pipeline_8]), Tolerance=0.1, CullMode=3)  # -> Points, Indices, Valence
del = DelaunayMesh(Points=cullpt.Points, Plane=xy)
facen = FaceNormals(Mesh=del)  # -> Centers, Normals
incurve = PointInCurve(Point=facen.Centers, Curve=pipeline_6)  # -> Relationship, Point
equals = Equality(FirstNumber=incurve.Relationship, SecondNumber=2)  # -> Equality, Inequality
cullf = CullFaces(Mesh=del, Pattern=invert(equals.Equality))

# DRAW SPOT HEIGHTS
number_slider_7 = Slider(3, range=0..10)
pt_5 = Point([pipeline_8, cp_3.Points])
pdecon = Deconstruct(Point=pt_5)  # -> XComponent, YComponent, ZComponent
panel_12 = Panel("+")
roundd = RoundToDecimalPlace(NumberX=pdecon.ZComponent, DecimalPlace=number_slider_7, RoundType=0)  # -> Rounded, Difference
swatch_6 = ColourSwatch(SwatchColor=RGB(255, 255, 119))
concat = Concatenate(FragmentA=panel_12, FragmentB=roundd.Rounded)
text = DefineTextObject(
    Text=concat,
    Plane=pt_5,
    DimensionStyle="Default",
    Size=text_size,
    MaskColor=swatch_6,
    MaskMargin=number_slider_4,
    OutputType="Text")
panel_13 = Panel("SPOT HEIGHT")
list_8 = ValueList({"Default", "GH", "GH::GH BOUNDARY", "GH::GH POINTS FIXED", "GH::GH POINTS DESIGN", "GH::GH LINES FIXED", "GH::GH LINES DESIGN", "GH::GH STAIRS", "GH::GH RAMP", "GH::GH WALLS", "GH::GH CONTOUR", "GH::GH SPOT HEIGHTS", "GH::GH GRADIENTS", "GH::GH PEOPLE", "GH::GH ROCKS", "GH::GH BALUSTRADE", "GH::GH MESH", "GH::GH OFF"}, selected="GH::GH SPOT HEIGHTS")
attributes_7 = DefineObjectAttributes(Layer=list_8)
bake_4 = BakeObjects(Geometry=text, Attributes=attributes_7, BakeName=panel_13, Bake=bake_spotheights)

# DRAW VECTOR
number_slider_8 = Slider(1, range=0..2)
vector_color = ColourSwatch(SwatchColor=RGB(42, 0, 255))

# WATER FLOW
panel_14 = Panel("Mesh Flows")
objbynn_4 = GetObjectByNickname(NickName=panel_14)
onoff = EnableDisableObject(Objects=objbynn_4, Enabled=calc_flow, AllObjects_Object=mesh_flows)
list_9 = ValueList({"Default", "GH", "GH::GH GRADING BOUNDARY", "GH::GH GRADING POINTS", "GH::GH GRADING LINES", "GH::GH TIN", "GH::GH STAIRS", "GH::GH RAMP", "GH::GH WALLS", "GH::GH CONTOUR", "GH::GH SPOT HEIGHTS", "GH::GH GRADIENTS", "GH::GH PEOPLE", "GH::GH ROCKS", "GH::GH BALUSTRADE", "GH::GH OFF", "GH::GH WATER"}, selected="GH::GH WATER")
panel_15 = Panel("WATER")
swatch_7 = ColourSwatch(SwatchColor=RGB(255, 255, 171))
attributes_8 = DefineObjectAttributes(Name=panel_15, Layer=list_9)

quad = Quadrangulate(Mesh=cullf, Angle=0.03490658504, Ratio=0.875)  # -> Mesh, Count
medges = MeshEdges(Mesh=quad.Mesh)  # -> NakedEdges, InteriorEdges, NonManifoldEdges
geo = Geometry(flatten([medges.NakedEdges, medges.InteriorEdges]))
slope = MeshSlope(Mesh=quad.Mesh)  # -> MeshFaces, FaceCenters, FaceVectors, FaceSlopes, FaceSlopes_2, FaceSlopes_3
bake_5 = BakeObjects(Geometry=quad.Mesh, Attributes=attributes_6, Bake=bake_tin)
preview_8 = CustomPreview(Geometry=[medges.NakedEdges, medges.InteriorEdges], Material=swatch_5)

dispatch_3 = Dispatch(List=geo, DispatchPattern=line_grades)  # -> ListA, ListB
eval = EvaluateCurve(Curve=reparameterize(dispatch_3.ListA), Parameter=number_slider_5)  # -> Point, Tangent, Angle
abs = Absolute(Value=eval.Tangent)
devec = DeconstructVector(Vector=abs)  # -> XComponent, YComponent, ZComponent
vec = VectorXYZ(XComponent=devec.XComponent, YComponent=devec.YComponent, ZComponent=0)  # -> Vector, Length
angle = Angle(VectorA=abs, VectorB=vec.Vector)  # -> Angle, Reflex
tangent = Tangent(Value=angle.Angle)
division = Division(A=1, B=tangent)
roundd_2 = RoundToDecimalPlace(NumberX=division, DecimalPlace=number_slider_6, RoundType=0)  # -> Rounded, Difference
concat_2 = Concatenate(FragmentA=panel_10, FragmentB=roundd_2.Rounded)
python = GhPythonScript(x=concat_2)  # -> out, a
# ---------- python: Python ----------
__author__ = "Thomas Chapman"
__version__ = "2021.08.24"

import rhinoscriptsyntax as rs

if x == "1:":
    a = "1:0"
else:
    a = x
# ---------- end python ----------
text_2 = DefineTextObject(Text=python.a, Plane=eval.Point, DimensionStyle="Default", Size=line_grade_size, MaskColor=swatch_4, OutputType="Text")

demesh = DeconstructMesh(Mesh=quad.Mesh)  # -> Vertices, Faces, Colours, Normals
pdecon_2 = Deconstruct(Point=demesh.Vertices)  # -> XComponent, YComponent, ZComponent
extremums = MinMax(Number=pdecon_2.ZComponent)  # -> Minimum, Maximum
addition = Addition(A=extremums.Maximum, B=1)
Z_4 = UnitZ(Factor=addition)
move_5 = Move(Geometry=pipeline_6, Motion=Z_4)  # -> Geometry, Transform
pop2d = Populate2D(Region=move_5.Geometry, Count=water_density, Seed=1)
mesh_flows = FlowProjectionMesh(Mesh=quad.Mesh, Points=pop2d, Jump=0, Steps=0, Thread=False)  # -> FlowPoints, FlowPaths; disabled
crv_9 = Curve(mesh_flows.FlowPaths)
preview_9 = CustomPreview(Geometry=crv_9, Material=swatch_7)
bake_6 = BakeObjects(Geometry=crv_9, Attributes=attributes_8, Bake=bake_water)

face_centers = Point(flatten(slope.FaceCenters))
face_vectors = Vector(slope.FaceVectors)
multiplication_3 = Multiplication(A=face_vectors, B=arrow_length)
angles_vectors = VectorDisplayEx(Point=face_centers, Vector=multiplication_3, Colour=vector_color, Width=number_slider_8)

roundd_3 = RoundToDecimalPlace(NumberX=slope.FaceSlopes_3, DecimalPlace=number_slider_3, RoundType=0)  # -> Rounded, Difference
rep = ReplaceText(Text=roundd_3.Rounded, Find=panel_7, Replace=panel_8, RecursiveReplace=False)
concat_3 = Concatenate(FragmentA=panel_9, FragmentB=rep)
text_3 = DefineTextObject(
    Text=concat_3,
    Plane=slope.FaceCenters,
    DimensionStyle="Default",
    Justification=list_5,
    Size=text_size,
    MaskColor=swatch_3,
    MaskMargin=number_slider_4,
    OutputType="Text")
bake_7 = BakeObjects(Geometry=text_3, Attributes=attributes_5, Bake=bake_gradients)

# DRAW CONTOURS
contour = Contour(Shape=quad.Mesh, Point=Point(0, 0, 0), Direction=Vector(0, 0, 1), Distance=contour_interval)
swatch_8 = ColourSwatch(SwatchColor=RGB(0, 255, 255))
list_10 = ValueList({"Default", "GH", "GH::GH BOUNDARY", "GH::GH POINTS FIXED", "GH::GH POINTS DESIGN", "GH::GH LINES FIXED", "GH::GH LINES DESIGN", "GH::GH STAIRS", "GH::GH RAMP", "GH::GH WALLS", "GH::GH CONTOUR", "GH::GH SPOT HEIGHTS", "GH::GH GRADIENTS", "GH::GH PEOPLE", "GH::GH ROCKS", "GH::GH BALUSTRADE", "GH::GH MESH", "GH::GH OFF"}, selected="GH::GH CONTOUR")
panel_16 = Panel("CONTOUR")
preview_10 = CustomPreview(Geometry=contour, Material=swatch_8)
attributes_9 = DefineObjectAttributes(Name=panel_16, Layer=list_10, Color=swatch_8)
bake_8 = BakeObjects(Geometry=contour, Attributes=attributes_9, Bake=bake_contours)

# ----
num = Number(flatten(rep))
dispatch_4 = Dispatch(List=num, DispatchPattern=colour_grading)  # -> ListA, ListB
python_2 = GhPythonScript(x=dispatch_4.ListA)  # -> a, b, c, d, e
# ---------- python_2: Python ----------
__author__ = "Thomas Chapman"
__version__ = "2021.09.25"

import rhinoscriptsyntax as rs

#Capture Flat Grades

if x >= 100:
    a = True

if x == 0:
    a = True

#Capture optimal grades

if x >= 40 and x < 100:
    b = True

#Capture Borderline grades

if x >= 30 and x < 40:
    c = True

#Capture ramp grades

if x >= 14 and x < 30:
    d = True

#Capture steep grades

if x >= 1 and x < 14:
    e = True
# ---------- end python_2 ----------

# ---- group: GRAD (continued)
dispatch_5 = Dispatch(List=slope.MeshFaces, DispatchPattern=python_2.a)  # -> ListA, ListB
dispatch_6 = Dispatch(List=slope.MeshFaces, DispatchPattern=python_2.e)  # -> ListA, ListB
dispatch_7 = Dispatch(List=slope.MeshFaces, DispatchPattern=python_2.d)  # -> ListA, ListB
dispatch_8 = Dispatch(List=slope.MeshFaces, DispatchPattern=python_2.b)  # -> ListA, ListB
dispatch_9 = Dispatch(List=slope.MeshFaces, DispatchPattern=python_2.c)  # -> ListA, ListB
preview_11 = CustomPreview(Geometry=dispatch_6.ListA, Material=ColourSwatch(SwatchColor=RGBA(222, 26, 240, 93)))
preview_12 = CustomPreview(Geometry=dispatch_7.ListA, Material=ColourSwatch(SwatchColor=RGBA(240, 26, 26, 55)))
preview_13 = CustomPreview(Geometry=dispatch_9.ListA, Material=ColourSwatch(SwatchColor=RGBA(255, 123, 0, 61)))
preview_14 = CustomPreview(Geometry=dispatch_8.ListA, Material=ColourSwatch(SwatchColor=RGBA(8, 255, 0, 98)))
# MODELING TOOLS
preview_15 = CustomPreview(Geometry=dispatch_5.ListA, Material=ColourSwatch(SwatchColor=RGBA(0, 204, 255, 73)))

# ==== cluster RAMPFINDER
L = ClusterInput()
P = ClusterInput()
dispatch = Dispatch(List=L, DispatchPattern=P)  # -> ListA, ListB
flip = FlipCurve(Curve=dispatch.ListB)  # -> Curve, Flag
crv = Curve([dispatch.ListA, flip.Curve])
explode = Explode(Curve=crv, Recursive=True)  # -> Segments, Vertices
L_2 = ClusterInput()
end = EndPoints(Curve=crv)  # -> Start, End
F = ClusterInput()
F_2 = ClusterInput()
panel = Panel(explode.Segments)
divide_target = DivideByTargetLength(Curve=explode.Segments, Length=L_2)  # -> Points, Tangents, Parameters
cp = ControlPoints(Curve=crv)  # -> Points, Weights, Knots
lng = ListLength(List=cp.Points)
subtraction = Subtraction(A=lng, B=2)
Z = UnitZ(Factor=F)
Z_2 = UnitZ(Factor=F_2)
dom = ConstructDomain(DomainStart=Slider(1, range=0..1), DomainEnd=subtraction)
cull_i = CullIndex(List=divide_target.Parameters, Indices=[-1, 0], Wrap=True)  # -> simplify(List)
graft = GraftTree(Tree=explode.Segments, IncludeEmptyLists=True, IncludeNullItems=True)
move = Move(Geometry=end.End, Motion=Z)  # -> Geometry, Transform
move_2 = Move(Geometry=end.Start, Motion=Z_2)  # -> Geometry, Transform
subset = SubList(List=cp.Points, Domain=dom, Wrap=True)  # -> List, Index
clean = CleanTree(RemoveNulls=True, RemoveInvalid=True, RemoveEmpty=True, Tree=cull_i)
A = ClusterInput()
nulls_in_empty = NullsInEmptyBranches(DataWithEmptyBranches=cull_i)
crv_cp = CurveClosestPoint(Point=subset.List, Curve=crv)  # -> Point, Parameter, Distance
division = Division(A=A, B=2)
lenp = LengthParameter(Curve=crv, Parameter=crv_cp.Parameter)  # -> Length, Length_2
null = NullItem(Item=nulls_in_empty)  # -> NullFlags, InvalidFlags, Description
subtraction_2 = Subtraction(A=lenp.Length, B=division)
addition = Addition(A=lenp.Length, B=division)
dispatch_2 = Dispatch(List=graft, DispatchPattern=null.NullFlags)  # -> ListA, ListB

# ---- group: Kink Landings
eval = EvaluateLength(Curve=crv, Length=addition, Normalized=False)  # -> Point, Tangent, Parameter
eval_2 = EvaluateLength(Curve=crv, Length=subtraction_2, Normalized=False)  # -> Point, Tangent, Parameter

# ----
clean_2 = CleanTree(RemoveNulls=True, RemoveInvalid=True, RemoveEmpty=True, Tree=dispatch_2.ListB)  # -> simplify(Tree)
lenp_2 = LengthParameter(Curve=clean_2, Parameter=clean)  # -> Length, Length_2
subtraction_3 = Subtraction(A=lenp_2.Length, B=division)  # -> simplify(Result)
addition_2 = Addition(A=lenp_2.Length, B=division)  # -> simplify(Result)

# ---- group: Landing
eval_3 = EvaluateLength(Curve=clean_2, Length=addition_2, Normalized=False)  # -> Point, Tangent, Parameter
eval_4 = EvaluateLength(Curve=clean_2, Length=subtraction_3, Normalized=False)  # -> Point, Tangent, Parameter

# ----
null_2 = NullItem(Item=eval_2.Point)  # -> NullFlags, InvalidFlags, Description
null_3 = NullItem(Item=eval.Point)  # -> NullFlags, InvalidFlags, Description
python = GhPythonScript(x=null_2.NullFlags, z=eval_2.Point)  # -> out, a; inputs x: list, z: Point3d
# ---------- python: Python ----------
__author__ = "Thomas"
__version__ = "2021.08.15"

import rhinoscriptsyntax as rs

input = str(x)


if "True" in input:
    a = y
else:
    a = z
# ---------- end python ----------
python_2 = GhPythonScript(x=null_3.NullFlags, z=eval.Point)  # -> out, a; inputs x: list, z: Point3d; same code as python
clean_3 = CleanTree(RemoveNulls=True, RemoveInvalid=True, RemoveEmpty=False, Tree=python.a)
clean_4 = CleanTree(RemoveNulls=True, RemoveInvalid=True, RemoveEmpty=False, Tree=python_2.a)
pt = Point(flatten([eval_4.Point, clean_3, eval_3.Point, clean_4]))
pt_2 = Point(flatten([pt, end.End, end.Start]))
crv_cp_2 = CurveClosestPoint(Point=pt, Curve=crv)  # -> Point, Parameter, Distance
crv_cp_3 = CurveClosestPoint(Point=pt_2, Curve=crv)  # -> Point, Parameter, Distance
sort = SortList(Keys=crv_cp_2.Parameter)  # -> Keys, ValuesA
sort_2 = SortList(Keys=crv_cp_3.Parameter)  # -> Keys, ValuesA
lenp_3 = LengthParameter(Curve=crv, Parameter=sort.Keys)  # -> Length, Length_2
lenp_4 = LengthParameter(Curve=crv, Parameter=sort_2.Keys)  # -> Length, Length_2
panel_2 = Panel(lenp_4.Length)
reldif = RelativeDifferences(Values=lenp_3.Length)
reldif_2 = RelativeDifferences(Values=lenp_4.Length)
panel_3 = Panel(reldif_2)
extremums = MinMax(Number=reldif)  # -> Minimum, Maximum
eval_5 = EvaluateLength(Curve=crv, Length=lenp_3.Length, Normalized=False)  # -> Point, Tangent, Parameter
B = ClusterInput()
grade = ClusterInput()

# ---- group: RUN
num = Number(extremums.Maximum)

# ----
panel_4 = Panel(num)
similar = Similarity(FirstNumber=reldif_2, SecondNumber=B, Threshold=0.001)  # -> Similarity, AbsoluteDifference
expression = Expression(Run=num, Grade=grade, Expression="Run/Grade")
panel_5 = Panel(similar.Similarity)
dispatch_3 = Dispatch(List=reldif_2, DispatchPattern=similar.Similarity)  # -> ListA, ListB
cull = CullPattern(List=eval_5.Point, CullPattern=reverse([False, True]))  # -> simplify(graft(List))
cull_2 = CullPattern(List=eval_5.Point, CullPattern=[True, False])
cull_3 = CullPattern(List=eval_5.Point, CullPattern=[False, True])  # -> simplify(graft(List))
panel_6 = Panel(cull)
cull_i_2 = CullIndex(List=dispatch_3.ListB, Indices=[-1, 0], Wrap=True)
grade_2 = ClusterInput()
lng_2 = ListLength(List=cull_2)
series = Series(Start=expression, Step=expression, Count=lng_2)  # -> simplify(flatten(Series))
pt_3 = Point([cull_3, cull])
panel_7 = Panel(dispatch_3.ListB)
panel_8 = Panel(cull_i_2)
expression_2 = Expression(Run=cull_i_2, Grade=grade_2, Expression="Run/Grade")  # -> simplify(flatten(Rise))
panel_9 = Panel(cull_2)
panel_10 = Panel(expression_2)
ma = MassAddition(Input=expression_2)  # -> Result, PartialResults
panel_11 = Panel(series)

# ---- group: Corner Points
pt_4 = Point(simplify(graft(crv_cp.Point)))

# ---- group: Lower Anchor origin
pt_5 = Point(end.Start)

# ---- group: Upper Anchor Origin
pt_6 = Point(end.End)

# ---- group: Lower Anchor Target
pt_7 = Point(move_2.Geometry)

# ---- group: Top Anchor Target
pt_8 = Point(move.Geometry)

# ---- group: User Crv
geo = Geometry(crv)

# ----
B_2 = ClusterInput()
shatter = Shatter(Curve=geo, Parameters=eval_5.Parameter)
panel_12 = Panel(ma.PartialResults)
anchor = Anchor(Point=pt_6, Target=pt_8, Strength=10000)
anchor_2 = Anchor(Point=pt_5, Target=pt_7, Strength=10000)
show = Show(G=shatter)
addition_3 = Addition(A=ma.PartialResults, B=B_2)
Z_3 = UnitZ(Factor=addition_3)
move_3 = Move(Geometry=cull_2, Motion=Z_3)  # -> Geometry, Transform

# ---- group: Landing Plane Goal
pl = ConstructPlane(Origin=move_3.Geometry, XAxis=Vector(1, 0, 0), YAxis=Vector(0, 1, 0))  # -> simplify(graft(Plane))

# ----
dist = Distance(PointA=move_3.Geometry, PointB=pt_4)  # -> simplify(Distance)
onplane = OnPlane(Points=pt_3, Plane=pl, Strength=1)
panel_13 = Panel(addition_3)
extremums_2 = MinMax(Number=dist)  # -> simplify(Minimum), Maximum
panel_14 = Panel(pt_4)
mindex = MemberIndex(Set=dist, Member=extremums_2.Minimum)  # -> simplify(Index), Count
panel_15 = Panel(pl)
item = ListItem(List=flatten(pl), Index=mindex.Index, Wrap=True)
onplane_2 = OnPlane(Points=pt_4, Plane=item, Strength=1)
panel_16 = Panel(mindex.Index)
panel_17 = Panel(item)
reset = ClusterInput()
on = ClusterInput()
bouncysolver = BouncySolver(
    GoalObjects=[show, anchor_2, anchor, onplane, onplane_2],
    Reset=reset,
    Threshold=1e-15,
    Tolerance=0.0001,
    Damping=0.99,
    Iterations=10,
    On=on)  # -> I, V, O
list = ValueList({"Point": 0, "Curve": 1, "Arc": 2, "Circle": 3, "Ellipse": 4, "Line": 5, "Polyline": 6, "Surface": 7, "Brep": 8, "Mesh": 9, "Polysurface": 10, "Block": 11, "Text": 12, "TextDot": 13, "Dimension": 14, "LinearDimension": 15, "AngularDimension": 16, "Hatch": 17, "Leader": 18}, selected="Curve")
filtertype = FilterByType(Geometry=bouncysolver.O, ObjectType=list)
panel_18 = Panel(bouncysolver.O)
clean_5 = CleanTree(RemoveNulls=True, RemoveInvalid=True, RemoveEmpty=True, Tree=filtertype)
panel_19 = Panel(clean_5)
len = Length(Curve=clean_5)
B_3 = ClusterInput()
join = JoinCurves(Curves=clean_5, Preserve=False)
similar_2 = Similarity(FirstNumber=len, SecondNumber=B_3, Threshold=0.1)  # -> Similarity, AbsoluteDifference
D = ClusterInput()
offcrv = OffsetCurve(Curve=join, Plane=PlaneXY(0, 0, 0), Distance=D, BothSides=True, Kinks=0, CapType=0)
panel_20 = Panel(similar_2.Similarity)
loft = Loft(Curves=offcrv, Options={Adjust=False, Closed=False, LoftEnds=0, LoftSimp=0, LoftType=0, Rebuild=10, Refit=0.01})
dispatch_4 = Dispatch(List=clean_5, DispatchPattern=similar_2.Similarity)  # -> ListA, ListB
geo_2 = Geometry(dispatch_4.ListA)
wires = BrepWireframe(Brep=loft, Density=-1)
geo_3 = Geometry(dispatch_4.ListB)
end_2 = EndPoints(Curve=geo_3)  # -> Start, End
mp = Midpoint(Curve=geo_2)
W = ClusterOutput(wires)
M = ClusterOutput(mp)
pt_9 = Point(end_2.Start)
pt_10 = Point(end_2.End)

# ---- group: Bot Point
pt_11 = Point(move.Geometry)

# ---- group: Top Point
pt_12 = Point(move_2.Geometry)

# ----
pdecon = Deconstruct(Point=mp)  # -> XComponent, YComponent, ZComponent
pt_13 = ClusterOutput(pt_11)
pt_14 = ClusterOutput(pt_12)
pdecon_2 = Deconstruct(Point=pt_12)  # -> XComponent, YComponent, ZComponent
pdecon_3 = Deconstruct(Point=pt_11)  # -> XComponent, YComponent, ZComponent
pl_2 = ConstructPlane(Origin=pt_9, XAxis=Vector(1, 0, 0), YAxis=Vector(0, 1, 0))
python_3 = GhPythonScript(x=pdecon.ZComponent)  # -> out, a
# ---------- python_3: Python ----------
__author__ = "Thomas"
__version__ = "2021.08.14"

import rhinoscriptsyntax as rs

a = round(x,3)
# ---------- end python_3 ----------
Z_4 = ClusterOutput(pdecon_2.ZComponent)
Z_5 = ClusterOutput(pdecon_3.ZComponent)
a = ClusterOutput(python_3.a)
project = Project(Geometry=pt_10, Plane=pl_2)  # -> Geometry, Transform
dist_2 = Distance(PointA=project.Geometry, PointB=pt_10)
panel_21 = Panel(dist_2)
dist_3 = Distance(PointA=pt_9, PointB=project.Geometry)
panel_22 = Panel(dist_3)
midpt = CurveMiddle(Curve=geo_3)
expression_3 = Expression(Run=panel_22, Rise=panel_21, Expression="Run/Rise")
M_2 = ClusterOutput(midpt)
python_4 = GhPythonScript(x=expression_3)  # -> out, a; same code as python_3
a_2 = ClusterOutput(python_4.a)
panel_23 = Panel(expression_3)
list_2 = ValueList({"Default", "GH", "GH::GH GRADING BOUNDARY", "GH::GH GRADING POINTS", "GH::GH GRADING LINES", "GH::GH TIN", "GH::GH WATER", "GH::GH STAIRS", "GH::GH RAMP", "GH::GH WALLS", "GH::GH CONTOUR", "GH::GH SPOT HEIGHTS", "GH::GH GRADIENTS", "GH::GH ROCKS", "GH::GH GRADE LINE", "GH::GH OFF", "GH::GH RAMP FINDER"}, selected="GH::GH RAMP FINDER")
attributes = DefineObjectAttributes(Name="RAMP FINDER", Layer=list_2)
B_4 = ClusterInput()
bake = BakeObjects(Geometry=[join, loft], Attributes=attributes, Bake=B_4)

# ==== cluster Cluster
run = Slider(0.1, range=0..0.1)
C = ClusterInput()
ptdividelen = DivideLength(Curve=C, Distance=run, RoundUp=False, RoundDn=True)
lng = ListLength(List=ptdividelen)
B = ClusterInput()
multiplication = Multiplication(A=run, B=1000)
division = Division(A=multiplication, B=B)
division_2 = Division(A=division, B=1000)
series = Series(Start=0, Step=division_2, Count=lng)
Z = UnitZ(Factor=series)
move = Move(Geometry=ptdividelen, Motion=Z)  # -> Geometry, Transform
pline = PolyLine(Vertices=move.Geometry, Closed=False)
list = ValueList({"Default", "GH", "GH::GH GRADING BOUNDARY", "GH::GH GRADING POINTS", "GH::GH GRADING LINES", "GH::GH TIN", "GH::GH WATER", "GH::GH STAIRS", "GH::GH RAMP", "GH::GH WALLS", "GH::GH CONTOUR", "GH::GH SPOT HEIGHTS", "GH::GH GRADIENTS", "GH::GH PEOPLE", "GH::GH ROCKS", "GH::GH BALUSTRADE", "GH::GH OFF", "GH::GH SCATTER", "GH::GH GRADE LINE"}, selected="GH::GH GRADE LINE")
simplify = SimplifyCurve(Curve=pline)  # -> Curve, Simplified
attributes = DefineObjectAttributes(Name="GRADED CURVE", Layer=list)
C_2 = ClusterOutput(simplify.Curve)
B_2 = ClusterInput()
bake = BakeObjects(Geometry=simplify.Curve, Attributes=attributes, Bake=B_2)
